% Simulink data dictionary Hybrid_vehicle.sldd

Bdy_facTireFric_C = 0.018
Bdy_lenRadiusWheel_C = 0.32
Bdy_mEquivalentJ_C = 60
Bdy_mVeh_C = 1400
Bdy_vsqr2frc_C = 0.429

Drv_facSlopeWLTC_CUR = [0 0
 500 0.01
 1000 0.02
 1500 0.03
 2000 0.04
 2500 0.05
 3000 0.06
 3500 0.07
 4000 0.06
 4500 0.05
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 ]

Drv_kmhDesNEDC_CUR = [0 0
 10 0
 15 16
 24 16
 28 0
 50 0
 60 32
 85 32
 95 0
 120 0
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 ]

Drv_kmhDesWLTC_CUR = [1 0
 2 0
 3 0
 4 0
 5 0
 6 0
 7 0
 8 0
 9 0
 10 0
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 ]

Edr_pwrInverterLosses_MAP = [19500 15000 6000 4500
 13000 10000 4000 3000
 6600 4800 3000 2400
 3500 2800 2100 1750
 2990 2300 1610 1380
 1470 1260 1050 980
 600 600 600 600
 450 450 450 450
 160 160 160 160
 50 50 50 50
 160 160 160 160
 450 450 450 450
 600 600 600 600
 1470 1260 1050 980
 2530 1840 1610 1380
 3605 2555 2100 1750
 6000 4200 3000 2400
 12000 9000 4000 3000
 18000 13500 6000 4500]

Edr_pwr_LossMap_AXIS = [-150000 -100000 -60000 -35000 -23000 -7000 -2000 -1000 -200 0 200 1000 2000 7000 23000 35000 60000 100000 150000]
Edr_rpm_InvLossMap_AXIS = [0 2000 5000 12000]
Edr_rpm_MaxMinTq_AXIS = [0; 100; 200; 400; 1000; 2000; 4000; 5000; 6000; 7000; 8000; 10000; 12000]
Edr_tqEffMax_CUR = [220; 220; 220; 220; 220; 220; 220; 180; 150; 125; 106; 81; 65]
Edr_tqEffMin_CUR = [-1; -221.2; -221.4; -221.6; -221.8; -222; -222.2; -182.5; -152.7; -128; -109.3; -84.8; -69.2]
GbxFr_tqClutchMax_C = 500
GbxRe_facGbxReRatio_C = 10

Ice_Load2TqOptIgnLamOne_MAP = [0 0 0 0 0 0 0
 35 38 40 40 40 40 40
 70 76 80 80 80 80 80
 105 114 120 120 120 120 120
 140 152 160 160 160 160 160]

Ice_TqOptIgnLamOne2Load_MAP = [0 0 0 0 0 0 0
 45.7 42.1 40 40 40 40 40
 91.4 84.2 80 80 80 80 80
 137.14 126.3 120 120 120 120 120
 182.85 168.4 160 160 160 160 160]

Ice_derfacLoadDecrease_MAP = [-5 -10 -11 -12 -13 -14 -16 -24 -30 -40 -50 -60
 -200 -400 -440 -480 -520 -560 -640 -960 -1200 -1600 -2000 -2400
 -225 -450 -495 -540 -585 -630 -720 -1080 -1350 -1800 -2250 -2700
 -250 -500 -550 -600 -650 -700 -800 -1200 -1500 -2000 -2500 -3000
 -275 -550 -605 -660 -715 -770 -880 -1320 -1650 -2200 -2750 -3300
 -300 -600 -660 -720 -780 -840 -960 -1440 -1800 -2400 -3000 -3600
 -325 -650 -715 -780 -845 -910 -1040 -1560 -1950 -2600 -3250 -3900
 -350 -700 -770 -840 -910 -980 -1120 -1680 -2100 -2800 -3500 -4200
 -375 -750 -825 -900 -975 -1050 -1200 -1800 -2250 -3000 -3750 -4500
 -400 -800 -880 -960 -1040 -1120 -1280 -1920 -2400 -3200 -4000 -4800]

Ice_derfacLoadIncrease_MAP = [500 500 500 500 500 500 600 800 800 900 1000 1000
 30 50 50 50 60 80 90 100 150 200 250 300
 30 30 15 15 25 30 35 50 60 100 100 100
 30 30 20 15 20 25 35 40 50 150 300 200
 30 30 20 18 25 30 45 60 100 180 220 250
 30 30 20 20 35 40 60 100 120 200 250 300
 0 30 20 20 40 50 80 150 180 250 300 300
 0 0 20 20 40 70 100 200 250 300 300 0
 0 0 0 20 40 70 150 300 300 350 0 0
 0 0 0 0 0 0 0 0 0 0 0 0]

Ice_facEtaCocMax_MAP = [1 1 1 1 1 1 1
 1 1 1 1 1 1 1
 0.98 0.986 0.995 1 1 1 1
 0.955 0.965 0.975 0.985 0.99 0.995 0.998
 0.93 0.94 0.95 0.96 0.97 0.98 0.99]

Ice_facFuelEnRich_MAP = [1 1 1 1 1 1 1
 1 1 1 1 1 1 1
 1 1 1 1 1 1 1.04
 1 1 1 1.02 1.05 1.08 1.11
 1 1.02 1.05 1.08 1.12 1.17 1.25]

Ice_relLoad_AXIS = [0 40 80 120 160]
Ice_relLoad_LoadDyn_AXIS = [0 80 90 100 110 120 130 140 150 160]
Ice_relLoad_Max_CUR = [50 130 137 143 148 153 159 160 160 157 130 90]
Ice_rpm_AXIS = [0 1000 2000 3000 4000 5000 6000]
Ice_rpm_LoadDyn_AXIS = [500 1000 1100 1200 1300 1400 1600 2400 3000 4000 5000 6000]

Ice_tqLossesIce_MAP = [15 15 16 19 23 29 36
 13 13 14 17 21 27 34
 11 11 12 15 19 25 32
 11 11 12 15 19 25 32
 11 11 12 15 19 25 32]

Ice_tq_AXIS = [0 40 80 120 160]
Pnt_capBat_C = 54000
Pnt_facSocInit_C = 0.6
Pnt_resBatInner_C = 0.2

BDY_BUS = Simulink.Bus()
  Bdy_frcDrvRes: double
  Bdy_frcSlope: double
  Bdy_frcAccel: double
  Bdy_kmhVeh: double
  Bdy_vVeh: double
  Bdy_lenAltitudeVeh: double
  Bdy_lenDrivenVeh: double
  Bdy_wWheelsFr: double
  Bdy_wWheelsRe: double
  GbxRe_tqEffAxRe: double
  GbxFr_tqEffAxFr: double
  BrkRe_tqEffBrkAxRe: double
  BrkRe_tqEffBrkAxFr: double

ENV_BUS = Simulink.Bus()
  Env_kmhVehDes: double
  Env_facSlope: double

DRV_BUS = Simulink.Bus()
  Drv_tqPropDes: double
  Drv_tqBrkDes: double

BRK_BUS = Simulink.Bus()
  BrkRe_tqEffBrkAxRe: double
  BrkRe_tqEffBrkAxFr: double

EDR_BUS = Simulink.Bus()
  Edr_nEdr: double
  Edr_wEdr: double
  Edr_tqEffEdr: double
  Edr_pwrElecEffEdr: double
  Edr_pwrTotalLossesEdr: double

GBXRE_BUS = Simulink.Bus()
  GbxRe_tqEffAxRe: double
  GbxRe_facGbxReRatio: double
  GbxRe_wGearIn: double

PNT_BUS = Simulink.Bus()
  Pnt_facSocBat: double
  Pnt_uBatClamp: double
  Pnt_pwrElecBatLosses: double
  Pnt_pwrElecBat2Hvl: double
  Pnt_egyChemBat: double

ICE_BUS = Simulink.Bus()
  Ice_relLoad: double
  Ice_tqLossesIce: double
  Ice_tqEffIce: double
  Ice_nIce: double
  Ice_wIce: double
  Ice_tqAccelMoiIce: double
  Ice_mFuel: double
  Ice_mfFue: double
  Ice_be: double
  Ice_tqClutchIce: double

GBXFR_BUS = Simulink.Bus()
  GbxFr_tqClutchIce: double
  GbxFr_tqEffAxFr: double
  GbxFr_facGbxFrRatio: double

EcuEdr_Bus = Simulink.Bus()
  EcuEdr_tqEffEdrDes: double

EcuGbxRe_Bus = Simulink.Bus()
  test: double

EcuIce_Bus = Simulink.Bus()
  EcuIce_tqInrIceDes: double
  EcuIce_relLoadDes: double
  EcuIce_etaCocDes: double
  EcuIce_relFuelDes: double

EcuGbxFr_Bus = Simulink.Bus()
  EcuGbxFr_numGear: double
  EcuGbxFr_flgCloseClutch: boolean
  EcuGbxFr_tqClutchIceMax: double

EcuBrk_Bus = Simulink.Bus()
  EcuBrk_tqEffBrkAxReDes: double
  EcuBrk_tqEffBrkAxFrDes: double

VCO_BUS = Simulink.Bus()
  EcuEdr_Bus: EcuEdr_Bus
  EcuGbxRe_Bus: EcuGbxRe_Bus
  EcuIce_Bus: EcuIce_Bus
  EcuGbxFr_Bus: EcuGbxFr_Bus
  EcuBrk_Bus: EcuBrk_Bus

Ts = 0.001
unit_config = Simulink.ConfigSet(StartTime="0", StopTime="WS_DRV_BUS.Drv_tqPropDes.Time(end)", FixedStep="Ts", Solver="ode3", ProdHWDeviceType="Intel->x86-64 (Windows64)", SystemTargetFile="grt.tlc", TargetLang="C")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
gen_config = Simulink.ConfigSet(StartTime="0", StopTime="500", FixedStep="Ts", Solver="ode3", ProdHWDeviceType="Intel->x86-64 (Windows64)", SystemTargetFile="grt.tlc", TargetLang="C")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
Env_kmhVehDes = Simulink.Signal(DataType="double", Unit="km/h")  % Target vehicle speed
Env_facSlope = Simulink.Signal(DataType="double")  % Slope factor
Drv_tqPropDes = Simulink.Signal(Unit="N*m")  % Desired propulsion torque
Drv_tqBrkDes = Simulink.Signal(DataType="double", Unit="N*m")  % Desired brake torque
kph2mps = Simulink.Parameter(0.2777778)
Drv_kmh2gradtqDriver_C = Simulink.Parameter(200, DataType="double")
Drv_kmh2tqDriver_C = Simulink.Parameter(500, DataType="double")
Edr_nEdr = Simulink.Signal(DataType="double", Unit="rpm")  % EDR speed
Edr_wEdr = Simulink.Signal(DataType="double", Unit="rad/s")  % EDR speed
Drv_tqPreCtrlMass = Simulink.Signal(DataType="double", Unit="N*m")
Edr_tqEffEdr = Simulink.Signal(DataType="double")
Edr_pwrElecEffEdr = Simulink.Signal(DataType="double")
Vco_avoidBatEmpty_Y = Simulink.Parameter([1.1 0.8 NaN 0], DataType="double")
BrkRe_tqEffBrkAxRe = Simulink.Signal(DataType="double", Unit="N*m")
Edr_pwrTotalLossesEdr = Simulink.Signal(DataType="double")

ENUM_TEStMODE = enum(DefaultValue="MODE_A")
  MODE_A = 0
  MODE_B = 1
  MODE_C = 2

Edr_tq_MachLossMap_AXIS = Simulink.Parameter([-220 -180 -140 -100 -80 -60 -40 -20 -10 0 10 20 40 60 80 100 140 180 220], Unit="N*m")

Edr_pwrMachineLosses_MAP = Simulink.Parameter([330 1797 2921.3 3068.7 3271.4 3824.4 5068.4 8570.3 18430.7 73722.7 129936.3
 270 1394.9 2122.5 2118.7 2261.9 2714.3 3769.9 6220.4 12063.7 43354 80299.1
 210 1004.3 1378.1 1325.3 1466.1 1817.9 2638.9 4222.3 7506.3 21991.1 40463.7
 150 628.3 724.7 741.4 837.8 1131 1801.2 2764.6 4775.2 10157.8 18849.6
 120 452.4 494.3 512.7 594.8 871.3 1440.9 2211.7 3619.1 6534.5 12063.7
 90 292.8 301.6 329.2 421 666 1156.1 1771.9 2613.8 4304 7539.8
 60 148.7 158.3 184.3 272.3 485.9 888 1332 1843.1 3015.9 4523.9
 30 51.7 57.8 91.3 140.3 276.5 544.5 904.8 1223.1 1780.2 3568.8
 10 20.3 26.1 45.2 73.3 167.6 423.1 691.2 963.4 1466.1 2387.6
 0 10 18 25 50 100 200 400 800 1200 1400
 20 19.8 25.9 36.4 78.8 204.6 424.4 713.7 1067.3 1509.7 2287.5
 40 51.4 59.3 74.8 133.7 291.2 630.6 1018.9 1397.8 2096.7 3106.3
 70 144.9 156 175.9 225.1 440.9 881.9 1322.8 2025.5 3249.9 5215.2
 100 283.6 298.6 325 386.9 633.6 1156.7 1776.4 2981.9 5315.5 8939.8
 130 465.1 480.9 514.1 592 863.3 1432.7 2258.5 4429.9 8488.3 12425.2
 160 689.4 668.7 745 849.1 1148.8 1836.4 3168 6792.6 11377.5 17136
 220 1261.5 1286.8 1331.2 1450 1838.4 2699.1 5515.3 10895.4 17199.8 26288.3
 280 2017.6 2065.9 2126.6 2258.6 2707.2 3801.6 8512.7 14913.9 23297.2 36822.4
 340 2932.2 3033.6 3104.6 3261.1 3789.9 5157.5 12020 20478.5 31415.9 48787.1], DataType="double")

Edr_rpm_MachLossMap_AXIS = Simulink.Parameter([0 100 200 400 1000 2000 4000 6000 8000 10000 12000], DataType="double")
Enum_ModeCal = Simulink.Parameter(ENUM_TEStMODE.MODE_A, DataType="Enum: ENUM_TEStMODE")
Enum_ModeCalList = Simulink.Parameter([ENUM_TEStMODE.MODE_A, ENUM_TEStMODE.MODE_A, ENUM_TEStMODE.MODE_B], DataType="Enum: ENUM_TEStMODE")